# Grasshopper definition Week 1_njh.ghx (Grasshopper 1.0.7)

# ----
# Bounds
panel = Panel("""1
2
3
4
5""")
bounds = Bounds(Numbers=panel)
ghpython_script = GhPythonScript(x=panel)  # -> out, a; inputs x: list
# ---------- ghpython_script: Python ----------
__author__ = "voidj"
__version__ = "2025.09.24"

import rhinoscriptsyntax as rs
import Rhino.Geometry as rg

a = rg.Interval(float(min(x)), float(max(x)))
# ---------- end ghpython_script ----------
panel_2 = Panel(ghpython_script.a)
panel_3 = Panel(bounds)
equality = Equality(FirstNumber=bounds, SecondNumber=panel_3)  # -> Equality, Inequality
equality_2 = Equality(FirstNumber=bounds, SecondNumber=ghpython_script.a)  # -> Equality, Inequality
panel_4 = Panel(equality_2.Equality)

# ----
# Absolute
panel_5 = Panel("""2
2.7
-3.666
22222222222222222""")
abs = Absolute(Value=panel_5)
python = GhPythonScript(x=panel_5)  # -> out, a
# ---------- python: Python ----------
a=abs(float(x))
# ---------- end python ----------
panel_6 = Panel(abs)
panel_7 = Panel(python.a)
equals = Equality(FirstNumber=abs, SecondNumber=python.a)  # -> Equality, Inequality
panel_8 = Panel(equals.Equality)

panel_9 = Panel("""2
2.7
-3.666
22222222222222222""")
# Addition
panel_10 = Panel("""1
1.3
1.333
111111111111111""")
python_2 = GhPythonScript(x=panel_10, y=panel_9)  # -> out, a
# ---------- python_2: Python ----------
a=float(x)+float(y)
# ---------- end python_2 ----------
addition = Addition(A=panel_10, B=panel_9)
panel_11 = Panel(addition)
panel_12 = Panel(python_2.a)
equals_2 = Equality(FirstNumber=addition, SecondNumber=python_2.a)  # -> Equality, Inequality
panel_13 = Panel(equals_2.Equality)

# ----
# Mass-Multiplication
panel_14 = Panel("""2
2.7
-3.666""")
python_3 = GhPythonScript(x=panel_14)  # -> out, a, b; inputs x: list
# ---------- python_3: Python ----------
__author__ = "light-v4"
__version__ = "2025.09.15"

import rhinoscriptsyntax as rs

a=1
b=[]

for n in x:
    a=a*float(n)
    b.append(a)
# ---------- end python_3 ----------
mm = MassMultiplication(Input=panel_14)  # -> Result, PartialResults
panel_15 = Panel(mm.PartialResults)
panel_16 = Panel(mm.Result)
panel_17 = Panel(python_3.a)
panel_18 = Panel(python_3.b)
equals_3 = Equality(FirstNumber=mm.PartialResults, SecondNumber=python_3.b)  # -> Equality, Inequality
equals_4 = Equality(FirstNumber=mm.Result, SecondNumber=python_3.a)  # -> Equality, Inequality
panel_19 = Panel(equals_3.Equality)
panel_20 = Panel(equals_4.Equality)

panel_21 = Panel("""2
2.7
-3.666
22222222222222222""")
# Larger than
panel_22 = Panel("""1
1.3
1.333
111111111111111""")
larger = LargerThan(FirstNumber=panel_22, SecondNumber=panel_21)  # -> LargerThan, OrEqualTo
python_4 = GhPythonScript(x=panel_22, y=panel_21)  # -> out, a, b
# ---------- python_4: Python ----------
if x > y:
    a=True
else:
    a = False

if x >= y:
    b = True
else:
    b = False
# ---------- end python_4 ----------
panel_23 = Panel(larger.LargerThan)
panel_24 = Panel(python_4.a)
panel_25 = Panel(python_4.b)
panel_26 = Panel(larger.OrEqualTo)
equals_5 = Equality(FirstNumber=larger.OrEqualTo, SecondNumber=python_4.b)  # -> Equality, Inequality
equals_6 = Equality(FirstNumber=larger.LargerThan, SecondNumber=python_4.a)  # -> Equality, Inequality
panel_27 = Panel(equals_5.Equality)
panel_28 = Panel(equals_6.Equality)
