# Grasshopper definition absolute_complete.gh (Grasshopper 1.0.7)

panel = Panel("""2
2.7
-3.666
22222222222222222""")

panel_2 = Panel("DEF")
vec = VectorXYZ(XComponent="1", YComponent="-30", ZComponent="30")  # -> Vector, Length

abs = Absolute(Value=panel)
python = GhPythonScript(x=panel)  # -> out, a
# ---------- python: Python ----------
a=abs(float(x))
# ---------- end python ----------
panel_3 = Panel(abs)
panel_4 = Panel(python.a)
equals = Equality(FirstNumber=abs, SecondNumber=python.a)  # -> Equality, Inequality
panel_5 = Panel(equals.Equality)
