# Grasshopper definition addition_complete.gh (Grasshopper 1.0.7)

panel = Panel("""ABC
123456789123456789""")
panel_2 = Panel("""DEF
-123456789123456788""")

panel_3 = Panel("""2
2.7
-3.666
22222222222222222""")
panel_4 = Panel("""1
1.3
1.333
111111111111111""")
python = GhPythonScript(x=panel_4, y=panel_3)  # -> out, a
# ---------- python: Python ----------
a=float(x)+float(y)
# ---------- end python ----------
addition = Addition(A=panel_4, B=panel_3)
panel_5 = Panel(addition)
panel_6 = Panel(python.a)
equals = Equality(FirstNumber=addition, SecondNumber=python.a)  # -> Equality, Inequality
panel_7 = Panel(equals.Equality)
