# Grasshopper definition bounds_complete.gh (Grasshopper 1.0.8)

panel = Panel("""1
2
3
4
5""")
bounds = Bounds(Numbers=panel)
ghpython_script = GhPythonScript(x=panel)  # -> out, a; inputs x: list
# ---------- ghpython_script: Python ----------
__author__ = "voidj"
__version__ = "2025.09.24"

import rhinoscriptsyntax as rs
import Rhino.Geometry as rg

a = rg.Interval(float(min(x)), float(max(x)))
# ---------- end ghpython_script ----------
panel_2 = Panel(ghpython_script.a)
panel_3 = Panel(bounds)
equality = Equality(FirstNumber=bounds, SecondNumber=panel_3)  # -> Equality, Inequality
equality_2 = Equality(FirstNumber=bounds, SecondNumber=ghpython_script.a)  # -> Equality, Inequality
panel_4 = Panel(equality_2.Equality)
