# Grasshopper definition mass-multiplication _ complete.gh (Grasshopper 1.0.8)

panel = Panel("""2
2.7
-3.666""")
python = GhPythonScript(x=panel)  # -> out, a, b; inputs x: list
# ---------- python: Python ----------
__author__ = "light-v4"
__version__ = "2025.09.15"

import rhinoscriptsyntax as rs

a=1
b=[]

for n in x:
    a=a*float(n)
    b.append(a)
# ---------- end python ----------
mm = MassMultiplication(Input=panel)  # -> Result, PartialResults
panel_2 = Panel(mm.PartialResults)
panel_3 = Panel(mm.Result)
panel_4 = Panel(python.b)
panel_5 = Panel(python.a)
equals = Equality(FirstNumber=mm.PartialResults, SecondNumber=python.b)  # -> Equality, Inequality
equals_2 = Equality(FirstNumber=mm.Result, SecondNumber=python.a)  # -> Equality, Inequality
panel_6 = Panel(equals_2.Equality)
panel_7 = Panel(equals.Equality)
