# Grasshopper definition box_2pt_easy.ghx (Grasshopper 1.0.8)

panel = Panel("""import Rhino.Geometry as rg
def box_2pt_easy(x, y):
    \"\"\"
    Box 2Pt (Easy)
    
    Args:
        x (Point3D): First corner.
        y (Point3D): Second corner.
    
    Retruns:
        (Box)
        Box with corner x, y, created in World XY.
    \"\"\"
    # your code here

    min_x = min(x.X, y.X)
    max_x = max(x.X, y.X)
    min_y = min(x.Y, y.Y)
    max_y = max(x.Y, y.Y)
    min_z = min(x.Z, y.Z)
    max_z = max(x.Z, y.Z)
    
    origin_pt = rg.Point3d(min_x, min_y, min_z)
    
    z_vector = rg.Vector3d(0,0,1)
    plane_xy = rg.Plane(origin_pt, z_vector)
    
    x_size = rg.Interval(0, max_x - min_x)
    y_size = rg.Interval(0, max_y - min_y)
    z_size = rg.Interval(0, max_z - min_z)
    
    a = rg.Box(plane_xy, x_size, y_size, z_size)
    
    return a

a = box_2pt_easy(x, y)""")
panel_2 = Panel("E:\ARCHIVE\Grasshopper Definition & Study\grasshopper-component-challenges-main")
path = FilePath(panel_2)
box_2pt_easy = Box_2pt_easy(pkg_path=path, code=panel)  # -> result, gh_output, code_output
panel_3 = Panel(box_2pt_easy.result)

# ==== cluster Box_2pt_easy
pkg_path = ClusterInput()
code = ClusterInput()
testcases = GhPythonScript(pkg_path=pkg_path)  # -> a, b
# ---------- testcases: Python ----------
import sys
sys.path.append(pkg_path)

from grasshopper_challenges.testcases import box_2pt_easy

a = box_2pt_easy.tc_a
b = box_2pt_easy.tc_b
# ---------- end testcases ----------
python = GhPythonScript(Code=code, X=testcases.a, Y=testcases.b)
box = Box2Pt(PointA=testcases.a, PointB=testcases.b, Plane=PlaneXY(0, 0, 0))
judge = GhPythonScript(pkg_path=pkg_path, x=box, y=python)  # -> out, a
# ---------- judge: Python ----------
import sys
sys.path.append(pkg_path)

from grasshopper_challenges.judges import box_2pt_easy

a = box_2pt_easy.judge(x, y)
# ---------- end judge ----------
result = ClusterOutput(judge.a)
gh_output = ClusterOutput(box)
code_output = ClusterOutput(python)
