# Grasshopper definition replace_members_easy.ghx (Grasshopper 1.0.8)

panel = Panel("""def replace_members_easy(x, y, z):
    \"\"\"
    Replace Members (Easy)
    
    Args:
        x (List[int]): List to process.
        y (List[int]): Item(s) to replace.
        z (List[int]): Item(s) to replace with.
    
    Retruns:
        (List[int])
        All the items in x which are equal to items in y are replaced with items in z.
        
    \"\"\"
    # your code here
    target = z[0]
    
    return [target if i in y else i for i in x]

a = replace_members_easy(x, y, z)""")
panel_2 = Panel("E:\ARCHIVE\Grasshopper Definition & Study\grasshopper-component-challenges-main")
path = FilePath(panel_2)
replace_members_easy = Replace_members_easy(pkg_path=path, code=panel)  # -> result, gh_output, code_output
panel_3 = Panel(replace_members_easy.result)

# ==== cluster Replace_members_easy
pkg_path = ClusterInput()
code = ClusterInput()
testcases = GhPythonScript(pkg_path=pkg_path)  # -> a, b, c
# ---------- testcases: Python ----------
import sys
sys.path.append(pkg_path)

from ghpythonlib import treehelpers
from grasshopper_challenges.testcases import replace_members_easy

a = treehelpers.list_to_tree(replace_members_easy.tc_s)
b = treehelpers.list_to_tree(replace_members_easy.tc_f)
c = treehelpers.list_to_tree(replace_members_easy.tc_r)
# ---------- end testcases ----------
python = GhPythonScript(Code=code, X=testcases.a, Y=testcases.b, Z=testcases.c)
replace = ReplaceMembers(Set=testcases.a, Find=testcases.b, Replace=testcases.c)
judge = GhPythonScript(pkg_path=pkg_path, x=replace, y=python)  # -> out, a; inputs x: list, y: list
# ---------- judge: Python ----------
import sys
sys.path.append(pkg_path)

from grasshopper_challenges.judges import replace_members_easy

a = replace_members_easy.judge(x, y)
# ---------- end judge ----------
code_output = ClusterOutput(python)
gh_output = ClusterOutput(replace)
result = ClusterOutput(judge.a)
