# Grasshopper definition end_points_standard.ghx (Grasshopper 1.0.8)

panel = Panel("""import Rhino.Geometry as rg

def end_points_standard(x):
    \"\"\"
    End Points (Standard)
    
    Args:
        x (Curve): Curve
    
    Retruns:
        (Tuple[Point3d, Point3d])
        - Start point of curve x.
        - End point of curve x.
    \"\"\"
    
    # your code here
    if isinstance(x, rg.Polyline):
        return x[0], x[-1]
    elif isinstance(x, rg.Curve):
        return x.PointAtStart, x.PointAtEnd
    else:
        return None, None

a, b = end_points_standard(x)""")
path = FilePath("path-to-grasshopper-component-challenges-package")
end_points_standard = End_points_standard(pkg_path=path, code=panel)  # -> result_2, result, gh_output, gh_output_2, code_output, code_output_2
panel_2 = Panel(end_points_standard.result_2)
panel_3 = Panel(end_points_standard.result)

# ==== cluster End_points_standard
pkg_path = ClusterInput()
code = ClusterInput()
testcases = GhPythonScript(pkg_path=pkg_path)  # -> a
# ---------- testcases: Python ----------
import sys
sys.path.append(pkg_path)

from grasshopper_challenges.testcases import end_points_standard

a = end_points_standard.tc
# ---------- end testcases ----------
python = GhPythonScript(Code=code, X=testcases)  # -> A, B
end = EndPoints(Curve=testcases)  # -> Start, End
judge = GhPythonScript(pkg_path=pkg_path, x=end.Start, y=end.End, z=python.A, u=python.B)  # -> out, a, b; inputs x: Point3d, y: Point3d, z: Point3d, u: Point3d
# ---------- judge: Python ----------
import sys
sys.path.append(pkg_path)

from grasshopper_challenges.judges import end_points_standard

a = end_points_standard.judge_s(x, z)
b = end_points_standard.judge_e(y, u)
# ---------- end judge ----------
gh_output = ClusterOutput(end.Start)
code_output = ClusterOutput(python.A)
gh_output_2 = ClusterOutput(end.End)
code_output_2 = ClusterOutput(python.B)
result = ClusterOutput(judge.b)
result_2 = ClusterOutput(judge.a)
